# Grasshopper definition graphml_to_GH.gh (Grasshopper 1.0.8)
# plug-ins: ShapeDiverForGrasshopper

sddp = ShapeDiverDocumentPayload({AbsoluteTolerance=0, AngleTolerance=0, DistanceDisplayPrecision=0, GltfVersion="Gltf2", GrasshopperVersion="1.0.0008", InputGroups="{}", OutputGroups="{}", RelativeTolerance=0, RhinoVersion="8.18.25100.11001", UnitSystem=0, VersionCreated="1.25.0.0", VersionSaved="1.25.0.0"})
path = FilePath("C:\Users\CDH\Documents\GitHub\MaCAD25_Thesis\knowledge\streets_graph.graphml")
path_2 = FilePath("C:\Users\CDH\Documents\GitHub\MaCAD25_Thesis\knowledge\urban_graph.graphml")

# ---- group: Loads .graphml
py3 = Python3Script(streets_graph_path=path, urban_graph_path=path_2, reload_trigger=Button())  # -> out, nodes_buildings, connections_buildings, buildings, nodes_streets, streets; inputs streets_graph_path: String, urban_graph_path: String, reload_trigger: Boolean
# ---------- py3: Python ----------
# ----------------------------
# Node A: Load GraphML (Urban + Streets)
# ----------------------------
import Rhino.Geometry as rg
import networkx as nx
import os
from shapely import wkt
from Grasshopper import DataTree
from Grasshopper.Kernel.Data import GH_Path

def load_graphs(urban_path, streets_path):
    if not os.path.exists(urban_path):
        raise ValueError(f"Urban GraphML not found: {urban_path}")
    if not os.path.exists(streets_path):
        raise ValueError(f"Streets GraphML not found: {streets_path}")

    # Load graphs
    G_urban = nx.read_graphml(urban_path)
    G_streets = nx.read_graphml(streets_path)

    urban_nodes_tree = DataTree[object]()
    urban_geometries_tree = DataTree[object]()
    urban_edges = []
    street_nodes = []
    street_edges = []

    # Urban nodes and geometries by type
    for node_id, data in G_urban.nodes(data=True):
        node_type = data.get("type", "unknown")
        x, y = float(data["x"]), float(data["y"])
        pt = rg.Point3d(x, y, 0)

        if node_type == "building":
            branch = GH_Path(0)
        elif node_type == "public_space":
            branch = GH_Path(1)
        else:
            continue  # Skip street nodes or unknown types

        urban_nodes_tree.Add(pt, branch)

        geom_wkt = data.get("geometry_wkt")
        if geom_wkt:
            shape = wkt.loads(geom_wkt)
            if shape.geom_type == "Polygon":
                pts = [rg.Point3d(*p, 0) for p in shape.exterior.coords]
                poly = rg.Polyline(pts)
                urban_geometries_tree.Add(poly, branch)
            else:
                urban_geometries_tree.Add(None, branch)
        else:
            urban_geometries_tree.Add(None, branch)

    # Urban edges (same list for all)
    for u, v in G_urban.edges():
        u_data, v_data = G_urban.nodes[u], G_urban.nodes[v]
        line = rg.Line(
            rg.Point3d(float(u_data["x"]), float(u_data["y"]), 0),
            rg.Point3d(float(v_data["x"]), float(v_data["y"]), 0)
        )
        urban_edges.append(line)

    # Street nodes
    for node_id, data in G_streets.nodes(data=True):
        pt = rg.Point3d(float(data["x"]), float(data["y"]), 0)
        street_nodes.append(pt)

    # Street edges
    for u, v, data in G_streets.edges(data=True):
        geom_wkt = data.get("geometry_wkt")
        if geom_wkt:
            try:
                linestring = wkt.loads(geom_wkt)
                if linestring.geom_type == "LineString":
                    pts = [rg.Point3d(x, y, 0) for x, y in linestring.coords]
                    polyline = rg.Polyline(pts)
                    street_edges.append(polyline)
                else:
                    # Fallback: draw simple straight line
                    u_data = G_streets.nodes[u]
                    v_data = G_streets.nodes[v]
                    line = rg.Line(
                        rg.Point3d(float(u_data["x"]), float(u_data["y"]), 0),
                        rg.Point3d(float(v_data["x"]), float(v_data["y"]), 0)
                    )
                    street_edges.append(line)
            except:
                # Fallback in case of WKT parsing error
                u_data = G_streets.nodes[u]
                v_data = G_streets.nodes[v]
                line = rg.Line(
                    rg.Point3d(float(u_data["x"]), float(u_data["y"]), 0),
                    rg.Point3d(float(v_data["x"]), float(v_data["y"]), 0)
                )
                street_edges.append(line)
        else:
            # No geometry_wkt: fallback straight line
            u_data = G_streets.nodes[u]
            v_data = G_streets.nodes[v]
            line = rg.Line(
                rg.Point3d(float(u_data["x"]), float(u_data["y"]), 0),
                rg.Point3d(float(v_data["x"]), float(v_data["y"]), 0)
            )
            street_edges.append(line)
    return urban_nodes_tree, urban_edges, urban_geometries_tree, street_nodes, street_edges


# Inputs: urban_graph_path, streets_graph_path
# Outputs: a=urban_nodes (split in branches), b=urban_edges, c=urban_geometries (split), d=street_nodes, e=street_edges
nodes_buildings, connections_buildings, buildings, nodes_streets, streets = load_graphs(urban_graph_path, streets_graph_path)
# ---------- end py3 ----------

# ----
crv = Curve(py3.streets)
pt = Point(py3.nodes_buildings)
srf = Surface(py3.buildings)
preview = CustomPreview(Geometry=[crv, srf], Material=ColourSwatch(SwatchColor=RGB(0, 0, 0)))
bang = ExplodeTree(Data=py3.nodes_buildings)  # -> Branch0, Branch1

pt_2 = Point(py3.nodes_buildings)
pt_3 = Point([Point(240793.1514, 5068155.908, 0), Point(240814.8899, 5068152.987, 0), Point(240874.8611, 5068211.049, 0), Point(240817.6542, 5068277.526, 0), Point(240839.1407, 5068253.117, 0), Point(240857.1572, 5068204.577, 0)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])

crv_2 = Curve(py3.connections_buildings)
crv_3 = Curve(py3.buildings)
pt_4 = Point(py3.nodes_streets)

# ---- group: Overrides .graphml
py3_2 = Python3Script(updated_points=pt_3, node_ids=py3.connections_buildings, original_graphml=path, save_path=path, save_trigger=Button())  # -> out, a, b, c; inputs updated_points: list, node_ids: list, original_graphml: String, save_path: String, save_trigger: Boolean
# ---------- py3_2: Python ----------
# ----------------------------
# Node B: Save GraphML (Writer)
# ----------------------------
import networkx as nx
import os
import rhinoscriptsyntax as rs

def save_graph(updated_points, node_ids, original_graphml, save_path):
    # Check inputs
    if not os.path.exists(original_graphml):
        raise ValueError("Original GraphML file not found: " + original_graphml)
    if len(updated_points) != len(node_ids):
        raise ValueError("Number of updated points does not match number of node IDs.")

    # Load original graph
    G = nx.read_graphml(original_graphml)

    # Update node positions
    for pt_ref, node_id in zip(updated_points, node_ids):
        # Convert GUID reference to Point3d
        pt = rs.coerce3dpoint(pt_ref)
        if pt:  # Ensure conversion succeeded
            if node_id in G.nodes:
                G.nodes[node_id]["x"] = pt.X
                G.nodes[node_id]["y"] = pt.Y
        else:
            raise ValueError("Invalid point reference for node: " + str(node_id))

    # Write updated graph
    nx.write_graphml(G, save_path)
    print("GraphML saved successfully to:", save_path)

# Inputs:
# updated_points: List of Point3d or GUIDs (edited in Rhino)
# node_ids: List of node IDs (from Node A)
# original_graphml: Path to original .graphml
# save_path: Path to save updated .graphml
# save_trigger: Boolean button to trigger save

if save_trigger:
    save_graph(updated_points, node_ids, original_graphml, save_path)
# ---------- end py3_2 ----------

# ----
panel = Panel(py3.nodes_streets)
